# Grasshopper definition 221129_axolotl_infill_slicing.gh (Grasshopper 1.0.7)
# plug-ins: Axolotl Info

# ---- group: VARIABLES
objectradius = Slider(3.8, range=0..10)
objectheight = Slider(10, range=0..10)
layerheight = Slider(0.1, range=0..1)

# ----
path = FilePath()
addition = Addition(A=layerheight, B=objectradius)
merge = Merge(Data1=addition, Data2=objectradius)  # -> graft(Result)
division = Division(A=objectheight, B="2")
pt = ConstructPoint(XCoordinate=0, YCoordinate=0, ZCoordinate=division)
xy = XYPlane(Origin=pt)
division_2 = Division(A=layerheight, B="2")
division_3 = Division(A=objectheight, B=layerheight)

# ---- group: CSG
tpms = TPMS(Wavelength=Slider(1.5, range=0..10), type=0)
polygonextrusion = PolygonExtrusion(Radius=merge, SecondRadius=-1, Height=objectheight, Number=6, Plane=xy)
item = ListItem(List=flatten(polygonextrusion), Index=0, Wrap=True)  # -> Item, Item1
boolean_intersect = BooleanIntersect(DistanceObjectS=item.Item1, DistanceObject=tpms)
boolean_subtract = BooleanSubtract(DistanceObject=item.Item, DistanceObject_2=item.Item1)
boolean_union = BooleanUnion(DistanceObjectS=boolean_subtract, DistanceObject=boolean_intersect)

# ---- group: SLICING PLANES
series = Series(Start=division_2, Step=layerheight, Count=division_3)
pt_2 = ConstructPoint(XCoordinate=0, YCoordinate=0, ZCoordinate=series)
xy_2 = XYPlane(Origin=pt_2)

# ----
box = DomainBox(Base=PlaneXY(0, 0, 0), X="-5 to 5", Y="-5 to 5", Z="0 to 10")
isosurface_distancefunction = IsosurfaceDistancefunction(BoundingBox=box, NumberX=50, NumberY=50, NumberZ=50, Isovalue=0, Capped=False, DistanceObject=boolean_union, Refine=True)

# ---- group: GENERATE CURVES
resolution = Slider(300, range=0..350)
slice2d = Slice2D(DistanceObject=boolean_union, NumberU=resolution, NumberV=resolution, DimensionX=10, DimensionY=10, Plane=xy_2, type=0)  # -> Values, Mesh, simplify(Contours)

# ---- group: CURVES CLEANING
explode = Explode(Curve=slice2d.Contours, Recursive=True)  # -> Segments, Vertices
cullpt = CullDuplicates(Points=explode.Vertices, Tolerance=layerheight, CullMode=3)  # -> Points, Indices, Valence
lng = ListLength(List=cullpt.Points)
equals = Equality(FirstNumber=lng, SecondNumber="1")  # -> Equality, Inequality
dispatch = Dispatch(List=cullpt.Points, DispatchPattern=equals.Equality)  # -> ListA, ListB
clean = CleanTree(RemoveNulls=True, RemoveInvalid=True, RemoveEmpty=True, Tree=dispatch.ListB)  # -> simplify(Tree)

# ----
crv = Curve(slice2d.Contours)
panel = Panel("{0}")  # disabled
panel_2 = Panel(lng)
branch = TreeBranch(Tree=slice2d.Contours, Path=panel, MaintainPaths=True)  # disabled
toggle = BooleanToggle(True)

# ---- group: REPEAT FIRST VERTEX
item_2 = ListItem(List=clean, Index=0, Wrap=True)
ins = InsertItems(List=clean, Item=item_2, Indices="-1", Wrap=True)  # -> simplify(List)

# ----
pline = PolyLine(Vertices=ins, Closed=False)

# ---- group: POINTS
pt_3 = Point(flatten(ins))

# ----
split = SplitTree(Data=pline, Masks=flatten("{2;?}"))  # -> Positive, Negative
preview = CustomPreview(Geometry=pline, Material=ColourSwatch(SwatchColor=RGB(255, 255, 255)))
