# Grasshopper definition 000_compas_rpc.ghx (Grasshopper 1.0.7)

image_resource = ImageResource("C:\Users\ananya\Downloads\7a9d0d3e2678927b6d1994d9b078030b.png")
pt = Point(Point(30.75, 43.5, 0))
xy = XYPlane(Origin=pt)
python = GhPythonScript(
    path=image_resource,
    read=Button(),
    x_size="0 To 148.8",
    y_size="0 To 210",
    threshold=Slider(70, range=0..150),
    frame_to=xy)  # -> out, polyline, frame_from, frame_to; inputs frame_to: Plane
# ---------- python: Python ----------
from compas.rpc import Proxy
import os
from scriptcontext import sticky
from compas.geometry import Polyline, Transformation, Scale, Frame, Vector, Polygon
import Rhino.Geometry as rg

polyline_key = 'poly_{}'.format(str(ghenv.Component.InstanceGuid))
size_key = 'size_{}'.format(str(ghenv.Component.InstanceGuid))

if polyline_key not in sticky or size_key not in sticky:
    sticky[polyline_key] = None
    sticky[size_key] = None

if read:
    canvas = ghenv.Component.OnPingDocument()
    folder_path =  os.path.abspath(os.path.dirname(canvas.FilePath))
    with Proxy('silhoutte', path = folder_path) as sil:
        sticky[polyline_key],sticky[size_key] = sil.get_contours(path = path)[0], sil.get_contours(path = path)[1]


polylines = sticky[polyline_key]
size = sticky[size_key]

print size[0],size[1]
#scaling transform
frame_from = Frame([0, size[0], 0], Vector.Xaxis(), -Vector.Yaxis())
factor_x, factor_y, factor_z = x_size[1]/size[1], y_size[1]/size[0], 0
T = Scale.from_factors([factor_x,factor_y,factor_z], frame_from)
polyline_scaled = [poly.transformed(T) for poly in polylines]

#orienting transform
frame_to  = Frame(frame_to.Origin,frame_to.XAxis,frame_to.YAxis)
T1 = Transformation.from_frame_to_frame(frame_from, frame_to)
polyline = [poly.transformed(T1) for poly in polyline_scaled if poly.length > 50]
# ---------- end python ----------
draw = Draw(cg=[python.polyline, python.frame_from, python.frame_to])  # -> simplify(rg)
#   port cg: The COMPAS geometry or datastructure to be drawn.
#   port rg: The Rhino geometry object.
# ---------- draw: Python ----------
"""
Draws COMPAS geometry in Grasshopper.
"""
from ghpythonlib.componentbase import executingcomponent as component

from compas.artists import Artist


class CompasToRhinoGeometry(component):
    def RunScript(self, cg):
        if not cg:
            return None

        return Artist(cg).draw()
# ---------- end draw ----------
branch = TreeBranch(Tree=draw, Path="{0;0;0}", MaintainPaths=True)
intcrv = Interpolate(Vertices=branch, Degree=Slider(1, range=0..10), Periodic=invert(False), KnotStyle=1)  # -> Curve, Length, Domain
