# Grasshopper definition 221212_Slice & Reverse.gh (Grasshopper 1.0.7)

number_slider = Slider(10, range=0..100)
number_slider_2 = Slider(10, range=0..100)

# ---- group: initial flat list
python = GhPythonScript(x=number_slider, y=number_slider_2)  # -> out, a; inputs x: Int32, y: Int32
# ---------- python: Python ----------
import Rhino.Geometry as rg

points = []
# random gap between points
gap = 20
for i in range (y):
    # temporary list to create nested structure
    for j in range (x):
        p = rg.Point3d(j*gap,i*gap,0)
        points.append(p)
a = points
# ---------- end python ----------
points = PointList(Points=python.a, Size="5")

# ---- group: switch to see how the index order changes
toggle = BooleanToggle(True)

# ---- group: slice & reverse
python_2 = GhPythonScript(points=python.a, x=number_slider, y=number_slider_2, snake=toggle)  # -> out, flatten(a); inputs points: list, x: Int32, y: Int32, snake: Boolean
# ---------- python_2: Python ----------
"""
MasDfab 22-23
How to slice and reverse
"""



# === example to refresh memory about list slicing === #
exm = ["ur0", "ur1", "ur2", "ur3" ,"ur4" ,"ur5"]
# lets slice the list from index 1 to 4 (note: the value at index 4 ("ur4") will not be included, this is how slicing works)
print exm [1:4]
# we can reverse the order with adding "[::-1]"
print exm [1:4][::-1]



# now we can iterate through the points and change the order at specific index
if snake:
    for i, p in enumerate(points):
        # chosing an index that would indicate every second row in the grid
        # if it is too confusing: try to put a hardcoded value instead of "x"-slider to see which indices it picks
        if i % (2*x) == x:
            print i
            
            # creating a new list through reversing the sliced list "list[x:y]" with slicing method "[::-1]"
            sliced_reversed = points[i:(i+x)][::-1]
            
            # in case it is first row, we would add the values from list "points" and new "sliced_reversed"
            if i == x:
                update = points[:i] + sliced_reversed
            # if not, with every iteration we want to overwrite the list "update" with its previous values and new "sliced_reversed"
            else:
                update = update[:i] + sliced_reversed
            # adding one missing row of values from initial list "points"
            update = update + points[(i+x):(i+(2*x))]
    
    a = update
else:
    a = points
# ---------- end python_2 ----------
nurbs = NurbsCurve(Vertices=python_2.a, Degree=1, Periodic=False)  # -> Curve, Length, Domain
points_2 = PointList(Points=python_2.a, Size="5")

# ----
preview = CustomPreview(Geometry=nurbs.Curve, Material=ColourSwatch(SwatchColor=RGB(0, 132, 255)))
